# Dynamo graph Disconnect_script.dyn (Dynamo 2.10.1.3976)

boolean = BoolSelector(false)
python_script = Python(IN[0]=boolean)  # IronPython2
# ---------- python_script.python (99 lines) ----------
"""Copyright by: vudinhduybm@gmail.com"""
#region ___import all Library
import clr
import sys 
import System   
import math
import collections

from math import cos,sin,tan,radians

clr.AddReference("ProtoGeometry")
from Autodesk.DesignScript.Geometry import *

clr.AddReference("RevitAPI") 
import Autodesk
from Autodesk.Revit.DB import* 
from Autodesk.Revit.DB.Structure import*

clr.AddReference("RevitAPIUI") 
from Autodesk.Revit.UI import*
from Autodesk.Revit.UI.Selection import ISelectionFilter
clr.AddReference("System") 
from System.Collections.Generic import List

clr.AddReference("RevitNodes")
import Revit
clr.ImportExtensions(Revit.Elements)
clr.ImportExtensions(Revit.GeometryConversion)

clr.AddReference("RevitServices")
import RevitServices
from RevitServices.Persistence import DocumentManager
from RevitServices.Transactions import TransactionManager

clr.AddReference("System.Windows.Forms")
clr.AddReference("System.Drawing")
clr.AddReference("System.Windows.Forms.DataVisualization")

import System.Windows.Forms 
from System.Windows.Forms import *
import System.Drawing
from System.Drawing import *
#endregion

#region ___Current doc/app/ui
doc = DocumentManager.Instance.CurrentDBDocument
uiapp = DocumentManager.Instance.CurrentUIApplication
app = uiapp.Application
uidoc = DocumentManager.Instance.CurrentUIApplication.ActiveUIDocument
view = doc.ActiveView
#endregion
#region ___someFunctions
def uwList(input):
    result = input if isinstance(input, list) else [input]
    return UnwrapElement(input)
def flatten(nestedList):
    flatList = []
    for item in nestedList:
        if isinstance(item, list):
            flatList.extend(flatten(item))
        else:
            flatList.append(item)
    return flatList
class PipeSelectionFilter(ISelectionFilter):
    def AllowElement(self, element):
        category = element.Category
        if category is None:
            return False
        return category.Name in ["Pipes", "Pipe Fittings", "Pipe Accessories"]
    def AllowReference(self, reference, position):
        return False
# Pick the element
def pickElement():
    pipeFilter = PipeSelectionFilter()
    ref = uidoc.Selection.PickObject(Autodesk.Revit.UI.Selection.ObjectType.Element, pipeFilter, "Pick a pipe, fitting, or accessory")
    element = doc.GetElement(ref.ElementId)
    return element
# Disconnect all connectors of the element
def findConnectors(element):
    connectors = []
    if element.Category.Name == "Pipes":
        connectors = [conn for conn in element.ConnectorManager.Connectors]
    if element.Category.Name != "Pipes":
        connectors = [conn for conn in element.MEPModel.ConnectorManager.Connectors]
    return connectors
def disconnectConnectors(element):
    connectors = findConnectors(element)
    for connector in connectors:
        for connected_connector in connector.AllRefs:
            if connected_connector.IsConnected:
                connector.DisconnectFrom(connected_connector)
    return connectors
#endregion
eleList   = uwList(IN[0])
# Do some action in a Transaction
TransactionManager.Instance.EnsureInTransaction(doc)
ele = pickElement()
TransactionManager.Instance.TransactionTaskDone()
OUT = disconnectConnectors(ele)
# ----------------------------------------
